# Grasshopper definition procedural_modeling_of_muqarnas_with_previews.gh (Grasshopper 1.0.7)

panel = Panel("Large Biped")
pt = Point(Point(8.288342194, 3.240290566, 0))
pt_2 = Point(Point(9, 2, 0))
pt_3 = Point(Point(8, 2, 0))
large_biped = LargeBiped(origin=pt_3, direction_pt=pt_2, symmetry_pt=pt, module=Slider(1, range=0..3))  # -> jug_and_its_biped, vertices_2, diagonal, module_3
crv = Curve(large_biped.jug_and_its_biped)

panel_2 = Panel("Almond (as a cell)")
pt_4 = Point(Point(7, 4, 0))
pt_5 = Point(Point(6.769601552, 5.708811235, 0))
pt_6 = Point(Point(6, 4, 0))
almond = Almond(g_origin=pt_6, directionpt=pt_4, symmetry_point=pt_5, module=Slider(1, range=1..3))  # -> almond, vertices_2, diagonal_ga, module_3
crv_2 = Curve(almond.almond)

# ----
# Rhombus with 135 degree angle
number_slider = Slider(1, range=1..3)
pt_7 = Point(Point(3.5, 2, 0))
pt_8 = Point(Point(4, 2, 0))
pt_9 = Point(Point(3.573400147, 3.090013528, 0))
rhombus_135 = Rhombus135(origin_a=pt_7, directionpt=pt_8, symmetrypt=pt_9, module=number_slider)  # -> rhombus_135, vertices_2, diagonal_ag, module_5
crv_3 = Curve(rhombus_135.rhombus_135)

# ----
# Rhombus with a 45 degree angle
number_slider_2 = Slider(1, range=0..3)
B = Point(Point(3, 4, 0))
pt_10 = Point(Point(4, 4, 0))
pt_11 = Point(Point(3.012104384, 4.853535715, 0))
rhombus_45 = Rhombus45(origin=B, direction_point=pt_10, symmetry_point=pt_11, module=number_slider_2)  # -> rhombus_2, vertices_2, diagonal_bd, module_3
crv_4 = Curve(rhombus_45.rhombus_2)

panel_3 = Panel("Square")
pt_12 = Point(Point(1, 5, 0))
pt_13 = Point(Point(1.115125878, 4.541255702, 0))
pt_14 = Point(Point(2, 5, 0))
square = Square(origin=pt_12, directionpt=pt_14, symmetrypt=pt_13, module=Slider(1, range=0..3))  # -> square_2, vertices, diagonal_ad, module_4
rec = Rectangle(square.square_2)

# ----
# Small biped - complement of an almond to a rhombus
number_slider_3 = Slider(1, range=1..3)
pt_15 = Point(Point(8, 4, 0))
pt_16 = Point(Point(9, 4, 0))
pt_17 = Point(Point(9.032034924, 5.329934833, 0))
small_biped = SmallBiped(g_origin=pt_15, directionpt_b=pt_16, orientation_point=pt_17, module=number_slider_3)  # -> biped_2, vertices_2, diagonal_ga, module_3
crv_5 = Curve(small_biped.biped_2)

# ----
# 90 for half-square, 45 or 135 for half-rhombus
number_slider_4 = Slider(1, range=1..3, expression="45*x")

# ----
# 90 for half-square, 45 or 135 for half-rhombus
number_slider_5 = Slider(2, range=1..3, expression="45*x")

# ----
# 90 for half-square, 45 or 135 for half-rhombus
number_slider_6 = Slider(3, range=1..3, expression="45*x")

# ----
# Half-shapes (square and rhombuses)
number_slider_7 = Slider(1, range=1..3)
pt_18 = Point(Point(4, 0, 0))
pt_19 = Point(Point(1.380049112, 2.824690374, 0))
pt_20 = Point(Point(3, 0, 0))
half_shape = HalfShape(origin=pt_20, direction_pt=pt_18, symmetry_pt=pt_19, module=number_slider_7, angle=number_slider_4)  # -> half_shape, vertices_2, diagonal, module_3
crv_6 = Curve(half_shape.half_shape)

# ----
# Half-shapes (square and rhombuses)
number_slider_8 = Slider(1, range=1..3)
pt_21 = Point(Point(2, 2, 0))
pt_22 = Point(Point(1.380049112, 2.824690374, 0))
pt_23 = Point(Point(1, 2, 0))
half_shape_2 = HalfShape(origin=pt_23, direction_pt=pt_21, symmetry_pt=pt_22, module=number_slider_8, angle=number_slider_5)  # -> half_shape, vertices_2, diagonal, module_3
crv_7 = Curve(half_shape_2.half_shape)

# ----
# Half-shapes (square and rhombuses)
number_slider_9 = Slider(1, range=1..3)
pt_24 = Point(Point(7, 0, 0))
pt_25 = Point(Point(1.380049112, 2.824690374, 0))
pt_26 = Point(Point(6.5, 0, 0))
half_shape_3 = HalfShape(origin=pt_26, direction_pt=pt_24, symmetry_pt=pt_25, module=number_slider_9, angle=number_slider_6)  # -> half_shape, vertices_2, diagonal, module_3
crv_8 = Curve(half_shape_3.half_shape)

# ----
# To build a tier:
# 1. Pick a shape
# 2. Create its 3D represenation with Make Cell, Cell 1/2 or Make Int
# 3. Build the polar Arrays along the Super Center (very center of the muqarna)
# 4. Get the Next points using the 2D shape array of this tier, the Union of the previous tier and the Super Center.
# 5. Adjust the tier: the top tier is an input of the whole circuit, then you can do a subtraction of 1 to get each new tier. Thing I noticed: do the subtraction when your new tier is composed of intermediary elements, but not when it's composed of cells
panel_4 = Panel("Clusters for 3D building")
make_curved_cell = MakeCurvedCell()
make_curved_int = MakeCurvedInt()

# ----
# Create an Intermediary Element from a Square or a Rhombus
make_int = MakeInt()

# ----
# Builds polar arrays of a shape and its corresponding 3D in a 360 degree angle
build_arrays = BuildArrays(super_center=Point(14.54789297, 7.542760032, 0))  # -> shape_array, _3d_array

# ----
# Gets points necessary to build the shape on the next tier
get_next_points = GetNextPoints()  # -> union, origin_2, direction_pt, symmetry_pt

# ----
# Adjusts the height of the 3D array according to the tier number
adjust_tier = AdjustTier(tier=2)

# ----
# Create a 3D Cell from any full shape
make_cell = MakeCell()

# ----
# 90 for half-square, 45 or 135 for half-rhombus
number_slider_10 = Slider(2, range=1..3, expression="45*x")

# ----
# Shape clusters to copy
# copy this slider as well, it's configured to return 45, 90 or 135 only
rhombus_45_2 = Rhombus45(origin=Point(2, 1, 0))  # -> rhombus_2, vertices_2, diagonal_bd, module_3
rhombus_135_2 = Rhombus135()  # -> rhombus_135, vertices_2, diagonal_ag, module_5
square_2 = Square()  # -> square_2, vertices, diagonal_ad, module_4
small_biped_2 = SmallBiped(module=1)  # -> biped_2, vertices_2, diagonal_ga, module_3
large_biped_2 = LargeBiped(origin=Point(5, 10, 0), module=3)  # -> jug_and_its_biped, vertices_2, diagonal, module_3
almond_2 = Almond(module=1)  # -> almond, vertices_2, diagonal_ga, module_3
half_shape_4 = HalfShape(origin=Point(9.401273785, 13.67906957, 0), angle=number_slider_10)  # -> half_shape, vertices_2, diagonal, module_3

# ----
# Create a Cell from any half-shape
cell_1_2 = Cell12()

rhombus_45_3 = Rhombus45_3()  # -> rhombus_2, diagonal_bd, rhombus_135, vertices_2, diagonal_ag, module_5

# ----
# This cluster builds 3 rhombuses-45 side by side in a 135 degree angle, as well as their 3D cells
_3_rhombuses_simple = _3RhombusesSimple()  # -> shape_partial_array, _3d_partial_array

module = Slider(1, range=1..3)
top_tier = Slider(2, range=0..5)
super_center = Point(Point(23, 10, 0))
dir1 = Point(Point(24, 10, 0))
sym1 = Point(Point(26.26568033, 5.831851936, 0))
module_2 = Slider(1, range=1..3)
top_tier_2 = Slider(2, range=0..5)
super_center_2 = Point(Point(36.33677303, 9.566194698, 0))
panel_5 = Panel("Example Model")
dir1_2 = Point(Point(36.75624219, 9.258705949, 0))
sym1_2 = Point(Point(26.26568033, 5.831851936, 0))
module_3 = Number(module)
module_4 = Number(module_2)
super_center_3 = Point(super_center)
super_center_4 = Point(super_center_2)
super_center_5 = Point(super_center_3)
super_center_6 = Point(super_center_4)
module_5 = Number(module_3)
module_6 = Number(module_4)
super_center_7 = Point(super_center_5)
super_center_8 = Point(super_center_6)
super_center_9 = Point(super_center_7)
super_center_10 = Point(super_center_8)
module_7 = Number(module_5)
module_8 = Number(module_6)
super_center_11 = Point(super_center_9)
super_center_12 = Point(super_center_10)
module_9 = Number(module_7)
module_10 = Number(module_8)
super_center_13 = Point(super_center_11)
super_center_14 = Point(super_center_12)
super_center_15 = Point(super_center_13)
super_center_16 = Point(super_center_14)

# ----
# 90 for half-square, 45 or 135 for half-rhombus
number_slider_11 = Slider(2, range=1..3, expression="45*x")

# ----
# 90 for half-square, 45 or 135 for half-rhombus
number_slider_12 = Slider(2, range=1..3, expression="45*x")

rhombus_45_4 = Rhombus45(origin=super_center, direction_point=dir1, symmetry_point=sym1, module=module_3)  # -> rhombus_2, vertices_2, diagonal_bd, module_3
# height of a tier is always 2 modules
number_slider_13 = Slider(8, range=8..9)
shape = Curve(rhombus_45_4.rhombus_2)
top_tier_3 = Number(top_tier)

make_curved_cell_2 = MakeCurvedCell(vertices=rhombus_45_4.vertices_2, diagonal=rhombus_45_4.diagonal_bd, module=rhombus_45_4.module_3)

rhombus_45_5 = Rhombus45(origin=super_center_2, direction_point=dir1_2, symmetry_point=sym1_2, module=module_4)  # -> rhombus_2, vertices_2, diagonal_bd, module_3
# height of a tier is always 2 modules
number_slider_14 = Slider(8, range=8..9)
shape_2 = Curve(rhombus_45_5.rhombus_2)
top_tier_4 = Number(top_tier_2)

make_cell_2 = MakeCell(vertices=rhombus_45_5.vertices_2, diagonal=rhombus_45_5.diagonal_bd, module=rhombus_45_5.module_3)

build_arrays_2 = BuildArrays(super_center=super_center_3, shape=shape, cell=make_curved_cell_2, shape_count=number_slider_13)  # -> shape_array, _3d_array
adjust_tier_2 = AdjustTier(tier=top_tier_3, _3d_array=build_arrays_2._3d_array, module=module_3)
geo = Geometry(adjust_tier_2)

crv_9 = Curve(build_arrays_2.shape_array)

get_next_points_2 = GetNextPoints(shape_arrays=crv_9, super_center=super_center_5)  # -> union, origin_2, direction_pt, symmetry_pt

square_3 = Square(
    origin=get_next_points_2.origin_2,
    directionpt=get_next_points_2.direction_pt,
    symmetrypt=get_next_points_2.symmetry_pt,
    module=module_5)  # -> square_2, vertices, diagonal_ad, module_4
make_curved_int_2 = MakeCurvedInt(vertices=square_3.vertices, diagonal=square_3.diagonal_ad, module=square_3.module_4)
shape_3 = Curve(square_3.square_2)
subtraction = Subtraction(A=top_tier_3, B=1)
num = Number(subtraction)
build_arrays_3 = BuildArrays(super_center=super_center_7, shape=shape_3, cell=make_curved_int_2, shape_count=Slider(8, range=8..9))  # -> shape_array, _3d_array
prev_union = Curve(get_next_points_2.union)
adjust_tier_3 = AdjustTier(tier=num, _3d_array=build_arrays_3._3d_array, module=module_5)
get_next_points_3 = GetNextPoints(shape_arrays=[prev_union, build_arrays_3.shape_array], super_center=super_center_9)  # -> union, origin_2, direction_pt, symmetry_pt
geo_2 = Geometry(adjust_tier_3)

number_slider_15 = Slider(8, range=0..10)
_3_rhombuses_curved = _3RhombusesCurved(
    origin=get_next_points_3.origin_2,
    dir=get_next_points_3.direction_pt,
    sym=get_next_points_3.symmetry_pt,
    module=module_7)  # -> shape_partial_array, array
prev_union_2 = Curve(get_next_points_3.union)
build_arrays_4 = BuildArrays(
    super_center=super_center_11,
    shape=_3_rhombuses_curved.shape_partial_array,
    cell=_3_rhombuses_curved.array,
    shape_count=number_slider_15)  # -> shape_array, _3d_array
fix_3d_array = Fix3DArray(array=build_arrays_4._3d_array, super_center=super_center_11, shape_count=number_slider_15)
adjust_tier_4 = AdjustTier(tier=num, _3d_array=fix_3d_array, module=module_7)
crv_10 = Curve(build_arrays_4.shape_array)
get_next_points_4 = GetNextPoints_2(shape_arrays=[prev_union_2, crv_10], super_center=super_center_11)  # -> union, origin_2, direction_pt, symmetry_pt
get_next_points_5 = GetNextPoints(shape_arrays=[prev_union_2, crv_10], super_center=super_center_11)  # -> union, origin_2, direction_pt, symmetry_pt
geo_3 = Geometry(adjust_tier_4)

square_4 = Square(
    origin=get_next_points_5.origin_2,
    directionpt=get_next_points_5.direction_pt,
    symmetrypt=get_next_points_5.symmetry_pt,
    module=module_9)  # -> square_2, vertices, diagonal_ad, module_4
square_5 = Square(
    origin=get_next_points_4.origin_2,
    directionpt=get_next_points_4.direction_pt,
    symmetrypt=get_next_points_4.symmetry_pt,
    module=module_9)  # -> square_2, vertices, diagonal_ad, module_4
make_curved_int_3 = MakeCurvedInt(vertices=square_5.vertices, diagonal=square_5.diagonal_ad, module=square_5.module_4)
make_curved_int_4 = MakeCurvedInt(vertices=square_4.vertices, diagonal=square_4.diagonal_ad, module=square_4.module_4)
square_0 = Curve(square_4.square_2)
square_1 = Curve(square_5.square_2)
num_2 = Number(subtraction)
number_slider_16 = Slider(8, range=0..100)
subtraction_2 = Subtraction(A=num_2, B=1)
module_11 = Number(module_9)
build_arrays_5 = BuildArrays(super_center=super_center_13, shape=square_0, cell=make_curved_int_4, shape_count=number_slider_16)  # -> shape_array, _3d_array
build_arrays_6 = BuildArrays(super_center=super_center_13, shape=square_1, cell=make_curved_int_3, shape_count=number_slider_16)  # -> shape_array, _3d_array
num_3 = Number(subtraction_2)
prev_union_3 = Curve(get_next_points_5.union)
geo_4 = Geometry(flatten([build_arrays_5._3d_array, build_arrays_6._3d_array]))
crv_11 = Curve(flatten([build_arrays_5.shape_array, build_arrays_6.shape_array]))
prev_union_4 = Curve(get_next_points_4.union)
adjust_tier_5 = AdjustTier(tier=num_3, _3d_array=geo_4, module=module_11)
geo_5 = Geometry(adjust_tier_5)

module_12 = Number(module_11)

get_next_points_6 = GetNextPoints(shape_arrays=[prev_union_3, crv_11], super_center=super_center_15)  # -> union, origin_2, direction_pt, symmetry_pt
get_next_points_7 = GetNextPoints_2(shape_arrays=[prev_union_4, crv_11], super_center=super_center_15)  # -> union, origin_2, direction_pt, symmetry_pt
rhombus_135_3 = Rhombus135(
    origin_a=get_next_points_6.origin_2,
    directionpt=get_next_points_6.direction_pt,
    symmetrypt=get_next_points_6.symmetry_pt,
    module=module_12)  # -> rhombus_135, vertices_2, diagonal_ag, module_5
half_shape_5 = HalfShape(
    origin=get_next_points_7.origin_2,
    direction_pt=get_next_points_7.direction_pt,
    symmetry_pt=get_next_points_7.symmetry_pt,
    module=module_12,
    angle=number_slider_11)  # -> half_shape, vertices_2, diagonal, module_3
make_curved_cell_3 = MakeCurvedCell(vertices=rhombus_135_3.vertices_2, diagonal=rhombus_135_3.diagonal_ag, module=rhombus_135_3.module_5)
number_slider_17 = Slider(8, range=0..100)
cell_1_2_curved = Cell12Curved(vertices=half_shape_5.vertices_2, module=half_shape_5.module_3)
build_arrays_7 = BuildArrays(super_center=super_center_13, shape=rhombus_135_3.rhombus_135, cell=make_curved_cell_3, shape_count=number_slider_17)  # -> shape_array, _3d_array
build_arrays_8 = BuildArrays(super_center=super_center_13, shape=half_shape_5.half_shape, cell=cell_1_2_curved, shape_count=number_slider_17)  # -> shape_array, _3d_array
module_13 = Number(module_12)
geo_6 = Geometry([build_arrays_7._3d_array, build_arrays_8._3d_array])
adjust_tier_6 = AdjustTier(tier=num_3, _3d_array=geo_6, module=module_13)

crv_12 = Curve(build_arrays_8.shape_array)
crv_13 = Curve(build_arrays_7.shape_array)
geo_7 = Geometry(adjust_tier_6)
preview = CustomPreview(Geometry=[geo, geo_2, geo_3, geo_5, geo_7], Material=ColourSwatch(SwatchColor=RGB(219, 172, 77)))

build_arrays_9 = BuildArrays(super_center=super_center_4, shape=shape_2, cell=make_cell_2, shape_count=number_slider_14)  # -> shape_array, _3d_array
adjust_tier_7 = AdjustTier(tier=top_tier_4, _3d_array=build_arrays_9._3d_array, module=module_4)
geo_8 = Geometry(adjust_tier_7)

crv_14 = Curve(build_arrays_9.shape_array)

get_next_points_8 = GetNextPoints(shape_arrays=crv_14, super_center=super_center_6)  # -> union, origin_2, direction_pt, symmetry_pt

square_6 = Square(
    origin=get_next_points_8.origin_2,
    directionpt=get_next_points_8.direction_pt,
    symmetrypt=get_next_points_8.symmetry_pt,
    module=module_6)  # -> square_2, vertices, diagonal_ad, module_4
make_int_2 = MakeInt(vertices=square_6.vertices, diagonal=square_6.diagonal_ad, module=square_6.module_4)
shape_4 = Curve(square_6.square_2)
subtraction_3 = Subtraction(A=top_tier_4, B=1)
num_4 = Number(subtraction_3)
build_arrays_10 = BuildArrays(super_center=super_center_8, shape=shape_4, cell=make_int_2, shape_count=Slider(8, range=8..9))  # -> shape_array, _3d_array
prev_union_5 = Curve(get_next_points_8.union)
adjust_tier_8 = AdjustTier(tier=num_4, _3d_array=build_arrays_10._3d_array, module=module_6)
get_next_points_9 = GetNextPoints(shape_arrays=[prev_union_5, build_arrays_10.shape_array], super_center=super_center_10)  # -> union, origin_2, direction_pt, symmetry_pt
geo_9 = Geometry(adjust_tier_8)

_3_rhombuses_simple_2 = _3RhombusesSimple(
    origin=get_next_points_9.origin_2,
    dir=get_next_points_9.direction_pt,
    sym=get_next_points_9.symmetry_pt,
    module=module_8)  # -> shape_partial_array, _3d_partial_array

number_slider_18 = Slider(8, range=0..10)
prev_union_6 = Curve(get_next_points_9.union)
build_arrays_11 = BuildArrays(
    super_center=super_center_12,
    shape=_3_rhombuses_simple_2.shape_partial_array,
    cell=_3_rhombuses_simple_2._3d_partial_array,
    shape_count=number_slider_18)  # -> shape_array, _3d_array
fix_3d_array_2 = Fix3DArray(array=build_arrays_11._3d_array, super_center=super_center_12, shape_count=number_slider_18)
adjust_tier_9 = AdjustTier(tier=num_4, _3d_array=fix_3d_array_2, module=module_8)
crv_15 = Curve(build_arrays_11.shape_array)
get_next_points_10 = GetNextPoints_2(shape_arrays=[prev_union_6, crv_15], super_center=super_center_12)  # -> union, origin_2, direction_pt, symmetry_pt
get_next_points_11 = GetNextPoints(shape_arrays=[prev_union_6, crv_15], super_center=super_center_12)  # -> union, origin_2, direction_pt, symmetry_pt
geo_10 = Geometry(adjust_tier_9)

square_7 = Square(
    origin=get_next_points_11.origin_2,
    directionpt=get_next_points_11.direction_pt,
    symmetrypt=get_next_points_11.symmetry_pt,
    module=module_10)  # -> square_2, vertices, diagonal_ad, module_4
square_8 = Square(
    origin=get_next_points_10.origin_2,
    directionpt=get_next_points_10.direction_pt,
    symmetrypt=get_next_points_10.symmetry_pt,
    module=module_10)  # -> square_2, vertices, diagonal_ad, module_4
square_0_2 = Curve(square_7.square_2)
square_1_2 = Curve(square_8.square_2)
num_5 = Number(subtraction_3)
number_slider_19 = Slider(8, range=0..100)
subtraction_4 = Subtraction(A=num_5, B=1)
module_14 = Number(module_10)
num_6 = Number(subtraction_4)
prev_union_7 = Curve(get_next_points_11.union)
prev_union_8 = Curve(get_next_points_10.union)

make_int_3 = MakeInt(vertices=square_7.vertices, diagonal=square_7.diagonal_ad, module=square_7.module_4)
make_int_4 = MakeInt(vertices=square_8.vertices, diagonal=square_8.diagonal_ad, module=square_8.module_4)

build_arrays_12 = BuildArrays(super_center=super_center_14, shape=square_0_2, cell=make_int_3, shape_count=number_slider_19)  # -> shape_array, _3d_array
build_arrays_13 = BuildArrays(super_center=super_center_14, shape=square_1_2, cell=make_int_4, shape_count=number_slider_19)  # -> shape_array, _3d_array
geo_11 = Geometry(flatten([build_arrays_12._3d_array, build_arrays_13._3d_array]))
crv_16 = Curve(flatten([build_arrays_12.shape_array, build_arrays_13.shape_array]))
adjust_tier_10 = AdjustTier(tier=num_6, _3d_array=geo_11, module=module_14)
geo_12 = Geometry(adjust_tier_10)

module_15 = Number(module_14)

get_next_points_12 = GetNextPoints(shape_arrays=[prev_union_7, crv_16], super_center=super_center_16)  # -> union, origin_2, direction_pt, symmetry_pt
get_next_points_13 = GetNextPoints_2(shape_arrays=[prev_union_8, crv_16], super_center=super_center_16)  # -> union, origin_2, direction_pt, symmetry_pt
rhombus_135_4 = Rhombus135(
    origin_a=get_next_points_12.origin_2,
    directionpt=get_next_points_12.direction_pt,
    symmetrypt=get_next_points_12.symmetry_pt,
    module=module_15)  # -> rhombus_135, vertices_2, diagonal_ag, module_5
half_shape_6 = HalfShape(
    origin=get_next_points_13.origin_2,
    direction_pt=get_next_points_13.direction_pt,
    symmetry_pt=get_next_points_13.symmetry_pt,
    module=module_15,
    angle=number_slider_12)  # -> half_shape, vertices_2, diagonal, module_3
make_cell_3 = MakeCell(vertices=rhombus_135_4.vertices_2, diagonal=rhombus_135_4.diagonal_ag, module=rhombus_135_4.module_5)
number_slider_20 = Slider(8, range=0..100)
cell_1_2_2 = Cell12(vertices=half_shape_6.vertices_2, module=half_shape_6.module_3)
build_arrays_14 = BuildArrays(super_center=super_center_14, shape=rhombus_135_4.rhombus_135, cell=make_cell_3, shape_count=number_slider_20)  # -> shape_array, _3d_array
build_arrays_15 = BuildArrays(super_center=super_center_14, shape=half_shape_6.half_shape, cell=cell_1_2_2, shape_count=number_slider_20)  # -> shape_array, _3d_array
module_16 = Number(module_15)
geo_13 = Geometry([build_arrays_14._3d_array, build_arrays_15._3d_array])
adjust_tier_11 = AdjustTier(tier=num_6, _3d_array=geo_13, module=module_16)

crv_17 = Curve(build_arrays_15.shape_array)
crv_18 = Curve(build_arrays_14.shape_array)
geo_14 = Geometry(adjust_tier_11)
preview_2 = CustomPreview(Geometry=[geo_8, geo_9, geo_10, geo_12, geo_14], Material=ColourSwatch(SwatchColor=RGB(219, 172, 77)))

# ==== cluster Square
directionpt = ClusterInput()
symmetrypt = ClusterInput()
origin = ClusterInput()
directionpt_2 = Point(directionpt)
symmetrypt_2 = Point(symmetrypt)
origin_2 = Point(origin)
module = ClusterInput()

osym = Vector2Pt(PointA=origin_2, SymmetryPt=symmetrypt_2, Unitize=False)  # -> Vector, Length
odir = Vector2Pt(PointA=origin_2, DirectionPt=directionpt_2, Unitize=False)  # -> Vector, Length

module_2 = Number(module)
origin_3 = Point(origin_2)

# ----
# create one side of the square according to the direction
module_3 = Number(module_2)
line = LineSDL(Start=origin_3, Direction=odir.Vector, Length=module_3)

origin_4 = Point(origin_3)

# ----
# rotate this side according to the symmetry point's position
number_slider = Slider(90, range=45..90)
xprod = CrossProduct(VectorA=odir.Vector, VectorB=osym.Vector, Unitize=False)  # -> Vector, Length
rot3d = Rotate3D(Geometry=line, Angle=degrees(number_slider), Center=origin_4, Axis=xprod.Vector)  # -> Geometry, Transform

# ----
# Get the end-points of both created lines, and use them + the origin to create the square
curvepoint = PointOnCurve(line, parameter=1)
curvepoint_2 = PointOnCurve(rot3d.Geometry, parameter=1)
rec_3pt = Rectangle3Pt(PointA=origin_4, PointB=curvepoint, PointC=curvepoint_2)  # -> Rectangle, Length

square = Curve(rec_3pt.Rectangle)
square_2 = ClusterOutput(square)

# ----
# Get the square's vertices and diagonal
explode = Explode(Curve=square, Recursive=True)  # -> Segments, Vertices
item = ListItem(List=explode.Vertices, Index=0, Wrap=True)  # -> Item, Item1, Item2, Item3
ln = Line(StartPoint=item.Item2, EndPoint=item.Item)

module_4 = ClusterOutput(module_2)
diagonal_ad = ClusterOutput(ln)
vertices = ClusterOutput(explode.Vertices)

# ==== cluster SmallBiped
g_origin = ClusterInput()
orientation_point = ClusterInput()
directionpt_b = ClusterInput()
module = ClusterInput()
g_origin_2 = Point(g_origin)
orientation_point_2 = Point(orientation_point)
directionpt_b_2 = Point(directionpt_b)
module_2 = Number(module)
gb_vect = Vector2Pt(PointA=g_origin_2, PointB=directionpt_b_2, Unitize=False)  # -> Vector, Length
gor_vect = Vector2Pt(PointA=g_origin_2, PointB=orientation_point_2, Unitize=False)  # -> Vector, Length
gb = LineSDL(Start=g_origin_2, Direction=gb_vect.Vector, Length=module)
number_slider = Slider(45, range=0..90)
rotaxis = CrossProduct(VectorA=gb_vect.Vector, VectorB=gor_vect.Vector, Unitize=False)  # -> Vector, Length
curvepoint = PointOnCurve(gb, parameter=1)
B = Point(curvepoint)
multiplication = Multiplication(A=number_slider, B=Slider(-1, range=-2..-1))
gd = Rotate3D(Geometry=gb, Angle=degrees(number_slider), Center=g_origin_2, Axis=rotaxis.Vector)  # -> Geometry, Transform
module_3 = ClusterOutput(module_2)
ba_long = Rotate3D(Geometry=gb, Angle=degrees(multiplication), Center=B, Axis=rotaxis.Vector)  # -> Geometry, Transform
curvepoint_2 = PointOnCurve(gd.Geometry, parameter=1)
num = Number(expr("-x", multiplication))
D = Point(curvepoint_2)
ln = Line(StartPoint=g_origin_2, EndPoint=D)
ad_long = Rotate3D(Geometry=ln, Angle=degrees(num), Center=D, Axis=rotaxis.Vector)  # -> Geometry, Transform
find_a = CurveCurve(CurveA=ad_long.Geometry, CurveB=ba_long.Geometry)  # -> Points, ParamsA, ParamsB
A = Point(simplify(flatten(find_a.Points)))
vertices = Point([g_origin_2, D, A, B])
vertices_2 = ClusterOutput(vertices)
ba = Line(StartPoint=B, EndPoint=A)
ad = Line(StartPoint=A, EndPoint=D)
ln_2 = Line(StartPoint=g_origin_2, EndPoint=A)
panel = Panel("why 2 curves")
join = JoinCurves(Curves=[gb, ba, ad, gd.Geometry], Preserve=False)
biped = Curve(join)
diagonal_ga = ClusterOutput(ln_2)
biped_2 = ClusterOutput(biped)

# ==== cluster MakeCell
vertices = ClusterInput()
module = ClusterInput()
get_cell_segs = GetCellSegs(vertices=vertices)  # -> left_seg, right_seg, projection_seg
module_2 = Number(module)
diagonal = ClusterInput()
simple_arc = SimpleArc(segment=get_cell_segs.left_seg, module=module_2)  # -> simple_muqarnas_arc, module_3
simple_arc_2 = SimpleArc(segment=get_cell_segs.right_seg, module=module_2)  # -> simple_muqarnas_arc, module_3
diagonal_2 = Line(diagonal)
crv = Curve(simple_arc.simple_muqarnas_arc)
crv_2 = Curve(simple_arc_2.simple_muqarnas_arc)
multiplication = Multiplication(A=simple_arc.module_3, B="2")
Z = UnitZ(Factor=multiplication)
extr = Extrude(Base=diagonal_2, Direction=Z)
projecta = ProjectAlong(Geometry=crv, Plane=extr, Direction=get_cell_segs.projection_seg)  # -> Geometry, Transform
loft = Loft(
    Curves=[projecta.Geometry, crv_2],
    Options={Adjust=False, Closed=False, LoftEnds=0, LoftSimp=0, LoftType=3, Rebuild=10, Refit=0.01})
loft_2 = Loft(
    Curves=[crv, projecta.Geometry],
    Options={Adjust=False, Closed=False, LoftEnds=0, LoftSimp=0, LoftType=3, Rebuild=10, Refit=0.01})
join = BrepJoin(Breps=[loft_2, loft])  # -> LoftedCell, Closed
lofted_cell = ClusterOutput(join.LoftedCell)

# ==== cluster LargeBiped
symmetry_pt = ClusterInput()
direction_pt = ClusterInput()
origin = ClusterInput()
module = ClusterInput()
build_square_for_biped = BuildSquareForBiped(origin=origin, directionpt=direction_pt, symmetrypt=symmetry_pt, module=Slider(1, range=0..3))  # -> square, reverse_square, vertices, diagonal_da, module_3
module_2 = Number(module)
end = EndPoints(Curve=build_square_for_biped.diagonal_da)  # -> Start, End
crv = Curve(build_square_for_biped.reverse_square)
pt = Point(end.End)
polygon = Polygon(Plane=crv, Radius=module_2, Segments=Slider(8, range=8..9), FilletRadius=0)  # -> Polygon, Length
module_3 = ClusterOutput(module_2)
explode = Explode(Curve=crv, Recursive=True)  # -> Segments, Vertices
number_slider = Slider(0, range=0..7)
explode_2 = Explode(Curve=polygon.Polygon, Recursive=True)  # -> Segments, Vertices
item = ListItem(List=explode.Segments, Index=Slider(1, range=0..4), Wrap=True)  # -> simplify(flatten(Item)), simplify(flatten(Item1))
item_2 = ListItem(List=explode_2.Segments, Index=number_slider, Wrap=True)  # -> Item, Item1
item_3 = ListItem(List=explode_2.Vertices, Index=number_slider, Wrap=True)  # -> Item, Item1, Item2
ba = Line(simplify(flatten(item_2.Item)))
ad = Line(simplify(flatten(item_2.Item1)))
D = Point(item_3.Item2)
B = Point(item_3.Item)
join = JoinCurves(Curves=[ba, ad, item.Item, item.Item1], Preserve=False)
jug_and_its_biped = ClusterOutput(join)
explode_3 = Explode(Curve=join, Recursive=True)  # -> Segments, Vertices
item_4 = ListItem(List=explode_3.Vertices, Index=0, Wrap=True)  # -> Item, Item1, Item2, Item3
vertices = Point([item_4.Item3, item_4.Item2, item_4.Item1, item_4.Item])
ln = Line(StartPoint=item_4.Item3, EndPoint=item_4.Item1)
vertices_2 = ClusterOutput(vertices)
points = PointList(Points=vertices, Size=Slider(0.3, range=0..1))
diagonal = ClusterOutput(ln)

# ==== cluster MakeInt
vertices = ClusterInput()
module = ClusterInput()
get_cell_segs = GetCellSegs_2(vertices=vertices)  # -> left_seg, right_seg, projection_seg
module_2 = Number(module)
diagonal = ClusterInput()
simple_arc = SimpleArc(segment=get_cell_segs.left_seg, module=module_2)  # -> simple_muqarnas_arc, module_3
simple_arc_2 = SimpleArc(segment=get_cell_segs.right_seg, module=module_2)  # -> simple_muqarnas_arc, module_3
diagonal_2 = Line(diagonal)
crv = Curve(simple_arc.simple_muqarnas_arc)
crv_2 = Curve(simple_arc_2.simple_muqarnas_arc)
multiplication = Multiplication(A=simple_arc.module_3, B="2")
Z = UnitZ(Factor=multiplication)
extr = Extrude(Base=diagonal_2, Direction=Z)
projecta = ProjectAlong(Geometry=crv, Plane=extr, Direction=get_cell_segs.projection_seg)  # -> Geometry, Transform
loft = Loft(
    Curves=[projecta.Geometry, crv_2],
    Options={Adjust=False, Closed=False, LoftEnds=0, LoftSimp=0, LoftType=3, Rebuild=10, Refit=0.01})
loft_2 = Loft(
    Curves=[crv, projecta.Geometry],
    Options={Adjust=False, Closed=False, LoftEnds=0, LoftSimp=0, LoftType=3, Rebuild=10, Refit=0.01})
join = BrepJoin(Breps=[loft_2, loft])  # -> LoftedCell, Closed
lofted_cell = ClusterOutput(join.LoftedCell)

# ==== cluster Rhombus135
directionpt = ClusterInput()
symmetrypt = ClusterInput()
origin_a = ClusterInput()
module = ClusterInput()
module_2 = Number(module)
module_3 = Number(module_2)
origin_a_2 = Point(simplify(flatten(origin_a)))
directionpt_2 = Point(directionpt)
symmetrypt_2 = Point(symmetrypt)

odir = Vector2Pt(PointA=origin_a_2, DirectionPt=directionpt_2, Unitize=False)  # -> Vector, Length
osym = Vector2Pt(PointA=origin_a_2, SymmetryPt=symmetrypt_2, Unitize=False)  # -> Vector, Length

origin_a_3 = Point(simplify(flatten(origin_a_2)))
module_4 = Number(module_2)
module_5 = ClusterOutput(module_4)

# ----
# Construct first side of the rhombus
ad = LineSDL(Start=origin_a_2, Direction=odir.Vector, Length=module_3)

ad_2 = Line(ad)

# ----
# Rotate first side by 135 deg angle according to symmetry point
xprod = CrossProduct(VectorA=odir.Vector, VectorB=osym.Vector, Unitize=False)  # -> Vector, Length
origin_a_4 = Point(simplify(flatten(origin_a_2)))
line = LineSDL(Start=origin_a_4, Direction=xprod.Vector, Length=1)
ab = RotateAxis(Geometry=ad_2, Angle=degrees(Slider(135, range=45..135)), Axis=line)  # -> Geometry, Transform

end = EndPoints(Curve=ad_2)  # -> Start, End

# ----
# Build 3rd side by moving the 1st side along the vector of the 2nd side
ab_2 = Line(ab.Geometry)
bg = Move(Geometry=ad_2, Motion=ab_2)  # -> Geometry, Transform
end_2 = EndPoints(Curve=bg.Geometry)  # -> Start, End

end_3 = EndPoints(Curve=ab_2)  # -> Start, End
B = Point(flatten(end_3.End))

# ----
# Build 4th side by connecting remaining endpoints
D = Point(simplify(flatten(end.End)))
G = Point(simplify(flatten(end_2.End)))
dg = Line(StartPoint=D, EndPoint=G)

# ----
# Join the segments to form the rhombus
ab_3 = Line(ab.Geometry)
bg_2 = Line(bg.Geometry)
ad_3 = Line(ad)
dg_2 = Line(dg)
join = JoinCurves(Curves=flatten([ad_3, ab_3, bg_2, dg_2]), Preserve=False)

panel = Panel("Get the diagonal")
ag = Line(StartPoint=origin_a_3, EndPoint=G)

pt = Point([origin_a_3, B, G, D])

explode = Explode(Curve=join, Recursive=True)  # -> Segments, Vertices
cull_i = CullIndex(List=explode.Vertices, Indices="-1", Wrap=True)
vertices = Point(pt)
panel_2 = Panel("Get vertices")

points = PointList(Points=pt, Size=Slider(0.3, range=0..1))
rhombus_135 = ClusterOutput(join)
diagonal_ag = ClusterOutput(ag)
vertices_2 = ClusterOutput(vertices)
item = ListItem(List=vertices, Index=0, Wrap=True)  # -> Item, Item1, Item2, Item3
vertices_3 = Point([item.Item1, item.Item, item.Item3, item.Item2])

# ==== cluster Almond
g_origin = ClusterInput()
symmetry_point = ClusterInput()
module = ClusterInput()
directionpt = ClusterInput()
g_origin_2 = Point(simplify(flatten(g_origin)))
symmetry_point_2 = Point(symmetry_point)
directionpt_2 = Point(directionpt)
module_2 = Number(module)
module_3 = ClusterOutput(module)

osym = Vector2Pt(PointA=g_origin_2, PointB=symmetry_point_2, Unitize=False)  # -> Vector, Length
odir = Vector2Pt(PointA=g_origin_2, PointB=directionpt_2, Unitize=False)  # -> Vector, Length

panel = Panel("module?")

# ----
# Build 1st segment of the almond according to direction
gb = LineSDL(Start=g_origin_2, Direction=odir.Vector, Length=module_2)
curvepoint = PointOnCurve(gb, parameter=1)

# ----
# Get 2nd segment by rotating 1st segment by 45 degrees according to the symmetry point
number_slider = Slider(45, range=0..90)
crossprod = CrossProduct(VectorA=odir.Vector, VectorB=osym.Vector, Unitize=False)  # -> Vector, Length
gd = Rotate3D(Geometry=gb, Angle=degrees(number_slider), Center=g_origin_2, Axis=crossprod.Vector)  # -> Geometry, Transform

multiplication = Multiplication(A=number_slider, B=Slider(-2, range=-2..-1))
g_origin_3 = Point(simplify(flatten(g_origin_2)))
B = Point(simplify(flatten(curvepoint)))
num = Number(multiplication)
ba_long = Rotate3D(Geometry=gb, Angle=degrees(num), Center=B, Axis=crossprod.Vector)  # -> Geometry, Transform
curvepoint_2 = PointOnCurve(gd.Geometry, parameter=1)
num_2 = Number(expr("-x", multiplication))
D = Point(simplify(flatten(curvepoint_2)))
ln = Line(StartPoint=g_origin_2, EndPoint=D)
ad_long = Rotate3D(Geometry=ln, Angle=degrees(num_2), Center=D, Axis=crossprod.Vector)  # -> Geometry, Transform
find_a = CurveCurve(CurveA=ad_long.Geometry, CurveB=ba_long.Geometry)  # -> Points, ParamsA, ParamsB
A = Point(simplify(flatten(find_a.Points)))
vertices = Point(simplify([g_origin_2, D, A, B]))
vertices_2 = ClusterOutput(vertices)
points = PointList(Points=vertices, Size=Slider(0.3, range=0..1))
ba = Line(StartPoint=B, EndPoint=A)
ad = Line(StartPoint=A, EndPoint=D)
join = JoinCurves(Curves=[gb, ba, ad, gd.Geometry], Preserve=False)
explode = Explode(Curve=join, Recursive=True)  # -> Segments, Vertices
ln_2 = Line(StartPoint=g_origin_3, EndPoint=A)
cull_i = CullIndex(List=explode.Vertices, Indices="0", Wrap=True)
almond = ClusterOutput(join)
diagonal_ga = ClusterOutput(ln_2)
points_2 = PointList(Points=cull_i, Size=Slider(0.3, range=0..1))

# ==== cluster Rhombus45
direction_point = ClusterInput()
module = ClusterInput()
origin = ClusterInput()
symmetry_point = ClusterInput()
module_2 = Number(module)
direction_point_2 = Point(direction_point)
origin_2 = Point(origin)
module_3 = ClusterOutput(module_2)
symmetry_point_2 = Point(symmetry_point)
vec2pt = Vector2Pt(PointA=origin_2, PointB=symmetry_point_2, Unitize=False)  # -> Vector, Length
vec2pt_2 = Vector2Pt(PointA=origin_2, PointB=direction_point_2, Unitize=False)  # -> Vector, Length
origin_3 = Point(origin_2)
xprod = CrossProduct(VectorA=vec2pt_2.Vector, VectorB=vec2pt.Vector, Unitize=False)  # -> Vector, Length
panel = Panel("Rhombus")
ba = LineSDL(Start=origin_3, Direction=vec2pt_2.Vector, Length=module_2)
line = LineSDL(Start=origin_3, Direction=xprod.Vector, Length=1)
ba_2 = Line(ba)
B = Point(simplify(flatten(origin_2)))
ba_3 = Line(ba)
bg = Rotate(Geometry=ba_2, Angle=degrees(Slider(45, range=0..100)), Plane=line)  # -> Geometry, Transform
curvepoint = PointOnCurve(ba_3, parameter=1)
curvepoint_2 = PointOnCurve(bg.Geometry, parameter=1)
A = Point(simplify(flatten(curvepoint)))
G = Point(simplify(flatten(curvepoint_2)))
vec = Vector(bg.Geometry)
ag = Line(StartPoint=G, EndPoint=A)
gd = Move(Geometry=ba_3, Motion=vec)  # -> Geometry, Transform
line_2 = LineSDL(Start=G, Direction=expr("-x", vec2pt.Vector), Length=module_2)
curvepoint_3 = PointOnCurve(gd.Geometry, parameter=1)
curvepoint_4 = PointOnCurve(ag, parameter=0.5)
ccx = CurveCurve(CurveA=ba_2, CurveB=line_2)  # -> Points, ParamsA, ParamsB
D = Point(simplify(flatten(curvepoint_3)))
vertices = Point([B, A, D, G])
bd = Line(StartPoint=B, EndPoint=D)
item = ListItem(List=vertices, Index=Slider(0, range=0..3), Wrap=True)
vertices_2 = ClusterOutput(vertices)
ad = Line(StartPoint=A, EndPoint=D)
E = Point(curvepoint_4)
join = JoinCurves(Curves=flatten([bg.Geometry, ba_3, gd.Geometry, ad]), Preserve=False)  # -> simplify(flatten(Curves))
rhombus = Curve(join)
diagonal_bd = ClusterOutput(bd)
rhombus_2 = ClusterOutput(rhombus)

# ==== cluster HalfShape
origin = ClusterInput()
angle = ClusterInput()
origin_2 = Point(simplify(flatten(origin)))
module = ClusterInput()
symmetry_pt = ClusterInput()
direction_pt = ClusterInput()
module_2 = Number(module)
angle_2 = Number(angle)
osym = Vector2Pt(PointA=origin_2, SymmetryPt=symmetry_pt, Unitize=False)  # -> Vector, Length
odir = Vector2Pt(PointA=origin_2, DirectionPt=direction_pt, Unitize=False)  # -> Vector, Length
xprod = CrossProduct(VectorA=odir.Vector, VectorB=osym.Vector, Unitize=False)  # -> Vector, Length
line = LineSDL(Start=origin_2, Direction=odir.Vector, Length=module_2)
line_2 = LineSDL(Start=origin_2, Direction=xprod.Vector, Length=1)
rotax = RotateAxis(Geometry=line, Angle=degrees(angle_2), Axis=line_2)  # -> Geometry, Transform
end = EndPoints(Curve=line)  # -> Start, End
end_2 = EndPoints(Curve=rotax.Geometry)  # -> Start, End
pt = Point(simplify(flatten(end.End)))
pt_2 = Point(simplify(flatten(end_2.End)))
ln = Line(StartPoint=pt, EndPoint=pt_2)
vertices = Point([origin_2, pt, pt_2])
join = JoinCurves(Curves=flatten([line, ln, rotax.Geometry]), Preserve=False)
diagonal = ClusterOutput(ln)
module_3 = ClusterOutput(module_2)
half_shape = ClusterOutput(join)
vertices_2 = ClusterOutput(vertices)

# ==== cluster Cell12
vertices = ClusterInput()
item = ListItem(Vertices=vertices, Index=0, Wrap=True)  # -> Item, Item1, Item2
module = ClusterInput()
module_2 = Number(module)
ln = Line(StartPoint=item.Item2, EndPoint=item.Item)
ln_2 = Line(StartPoint=item.Item1, EndPoint=item.Item)
simple_arc = SimpleArc(segment=ln, module=module_2)  # -> simple_muqarnas_arc, module_3
simple_arc_2 = SimpleArc(segment=ln_2, module=module_2)  # -> simple_muqarnas_arc, module_3
loft = Loft(
    Curves=[simple_arc_2.simple_muqarnas_arc, simple_arc.simple_muqarnas_arc],
    Options={Adjust=False, Closed=False, LoftEnds=0, LoftSimp=0, LoftType=0, Rebuild=10, Refit=0.01})
cell = ClusterOutput(loft)

# ==== cluster GetNextPoints
shape_arrays = ClusterInput()
super_center = ClusterInput()
get_near_far = GetNearFar(shape_arrays=shape_arrays, center=super_center)  # -> union_2, near, far
alongcrv = SortAlongCurve(Points=get_near_far.far, Curve=get_near_far.union_2)  # -> Points, Indices
alongcrv_2 = SortAlongCurve(Points=get_near_far.near, Curve=get_near_far.union_2)  # -> Points, Indices
points = PointList(Points=alongcrv_2.Points, Size=Slider(0.381, range=0..1))
item = ListItem(List=alongcrv_2.Points, Index=0, Wrap=True)
origin = Point(item)
get_dir_sym = GetDirSym(near_pt=item, far_list=alongcrv.Points)  # -> direction_pt_2, symmetry_pt_2
union = ClusterOutput(get_near_far.union_2)
origin_2 = ClusterOutput(origin)
direction_pt = ClusterOutput(get_dir_sym.direction_pt_2)
symmetry_pt = ClusterOutput(get_dir_sym.symmetry_pt_2)

# ==== cluster BuildArrays
super_center = ClusterInput()
shape = ClusterInput()
shape_count = ClusterInput()
cell = ClusterInput()
super_center_2 = Point(super_center)
shape_2 = Curve(shape)
shape_count_2 = Number(shape_count)
cell_2 = Brep(cell)
arrpolar = PolarArray(Geometry=shape_2, Plane=super_center_2, Count=shape_count_2, Angle=6.283185307)  # -> flatten(ShapeArray), Transform
arrpolar_2 = PolarArray(Geometry=cell_2, Plane=super_center_2, Count=shape_count_2, Angle=6.283185307)  # -> flatten(Geometry), Transform
shape_array = ClusterOutput(arrpolar.ShapeArray)
_3d_array = ClusterOutput(arrpolar_2.Geometry)

# ==== cluster _3RhombusesSimple
sym = ClusterInput()
dir = ClusterInput()
origin = ClusterInput()
sym_2 = Point(sym)
dir_2 = Point(dir)
origin_2 = Point(origin)
module = ClusterInput()
rhombus_45 = Rhombus45_2(origin=origin_2, direction_point=dir_2, symmetry_point=sym_2, module=module)  # -> rhombus_2, vertices_2, diagonal_bd, module_3
sym_3 = Point(sym_2)
dir_3 = Point(dir_2)
origin_3 = Point(origin_2)
make_cell = MakeCell(vertices=rhombus_45.vertices_2, diagonal=rhombus_45.diagonal_bd, module=rhombus_45.module_3)

orient_angle = OrientAngle(angle=Slider(135, range=45..135), origin=origin_3, dir=dir_3, sym=sym_3)
build_partial_arrays = BuildPartialArrays(
    shape=rhombus_45.rhombus_2,
    vertices=rhombus_45.vertices_2,
    cell=make_cell,
    count=Slider(3, range=0..10),
    angle=orient_angle)  # -> shape_partial_array, _3d_partial_array

join = BrepJoin(Breps=build_partial_arrays._3d_partial_array)  # -> _3DPartialArray, Closed
shape_partial_array = ClusterOutput(build_partial_arrays.shape_partial_array)
_3d_partial_array = ClusterOutput(join._3DPartialArray)

# ==== cluster AdjustTier
module = ClusterInput()
_3d_array = ClusterInput()
tier = ClusterInput()
get_height = GetHeight(module=module)
_3d_array_2 = Geometry(_3d_array)
tier_2 = Number(tier)
multiplication = Multiplication(A=tier_2, B=get_height)
Z = UnitZ(Factor=multiplication)
move = Move(Geometry=_3d_array_2, Motion=Z)  # -> MovedArray, Transform
moved_array = ClusterOutput(move.MovedArray)

# ==== cluster Rhombus45_3
directionpt = ClusterInput()
symmetrypt = ClusterInput()
origin_b = ClusterInput()
module = ClusterInput()
module_2 = Number(module)
module_3 = Number(module_2)
origin_b_2 = Point(simplify(flatten(origin_b)))
directionpt_2 = Point(directionpt)
symmetrypt_2 = Point(symmetrypt)

odir = Vector2Pt(PointA=origin_b_2, DirectionPt=directionpt_2, Unitize=False)  # -> Vector, Length
osym = Vector2Pt(PointA=origin_b_2, SymmetryPt=symmetrypt_2, Unitize=False)  # -> Vector, Length

origin_a = Point(simplify(flatten(origin_b_2)))
module_4 = Number(module_2)
module_5 = ClusterOutput(module_4)
join = JoinCurves(Preserve=False)  # -> simplify(flatten(Curves))
rhombus = Curve(join)
diagonal_bd = ClusterOutput()
rhombus_2 = ClusterOutput(rhombus)

# ----
# Construct first side of the rhombus
ba = LineSDL(Start=origin_b_2, Direction=odir.Vector, Length=module_3)

ba_2 = Line(ba)

# ----
# Rotate first side by 135 deg angle according to symmetry point
xprod = CrossProduct(VectorA=odir.Vector, VectorB=osym.Vector, Unitize=False)  # -> Vector, Length
origin_a_2 = Point(simplify(flatten(origin_b_2)))
line = LineSDL(Start=origin_a_2, Direction=xprod.Vector, Length=1)
bg = RotateAxis(Geometry=ba_2, Angle=degrees(Slider(135, range=45..135)), Axis=line)  # -> Geometry, Transform

end = EndPoints(Curve=ba_2)  # -> Start, End

# ----
# Build 3rd side by moving the 1st side along the vector of the 2nd side
bg_2 = Line(bg.Geometry)
ad = Move(Geometry=ba_2, Motion=bg_2)  # -> Geometry, Transform
end_2 = EndPoints(Curve=ad.Geometry)  # -> Start, End

# ----
# Build 4th side by connecting remaining endpoints
A = Point(simplify(flatten(end.End)))
D = Point(simplify(flatten(end_2.End)))
dg = Line(StartPoint=A, EndPoint=D)

# ----
# Join the segments to form the rhombus
ab = Line(bg.Geometry)
bg_3 = Line(ad.Geometry)
ad_2 = Line(ba)
dg_2 = Line(dg)
join_2 = JoinCurves(Curves=flatten([ad_2, ab, bg_3, dg_2]), Preserve=False)

panel = Panel("Get the diagonal")
ag = Line(StartPoint=origin_a, EndPoint=D)

explode = Explode(Curve=join_2, Recursive=True)  # -> Segments, Vertices
cull_i = CullIndex(List=explode.Vertices, Indices="-1", Wrap=True)
panel_2 = Panel("Get vertices")
vertices = Point(cull_i)

rhombus_135 = ClusterOutput(join_2)
diagonal_ag = ClusterOutput(ag)
vertices_2 = ClusterOutput(vertices)

# ==== cluster MakeCurvedCell
vertices = ClusterInput()
module = ClusterInput()
get_cell_segs = GetCellSegs(vertices=vertices)  # -> left_seg, right_seg, projection_seg
module_2 = Number(module)
diagonal = ClusterInput()
curved_arc = CurvedArc(segment=get_cell_segs.left_seg, module=module_2)  # -> curved_muqarnas_arc_2, module_3
curved_arc_2 = CurvedArc(segment=get_cell_segs.right_seg, module=module_2)  # -> curved_muqarnas_arc_2, module_3
diagonal_2 = Line(diagonal)
crv = Curve(curved_arc.curved_muqarnas_arc_2)
crv_2 = Curve(curved_arc_2.curved_muqarnas_arc_2)
multiplication = Multiplication(A=curved_arc.module_3, B="2")
Z = UnitZ(Factor=multiplication)
extr = Extrude(Base=diagonal_2, Direction=Z)
projecta = ProjectAlong(Geometry=crv, Plane=extr, Direction=get_cell_segs.projection_seg)  # -> Geometry, Transform
loft = Loft(
    Curves=flatten([projecta.Geometry, crv_2]),
    Options={Adjust=False, Closed=False, LoftEnds=0, LoftSimp=0, LoftType=3, Rebuild=10, Refit=0.01})
loft_2 = Loft(
    Curves=flatten([crv, projecta.Geometry]),
    Options={Adjust=False, Closed=False, LoftEnds=0, LoftSimp=0, LoftType=3, Rebuild=10, Refit=0.01})
join = BrepJoin(Breps=[loft_2, loft])  # -> LoftedCell, Closed
lofted_cell = ClusterOutput(join.LoftedCell)

# ==== cluster MakeCurvedInt
vertices = ClusterInput()
module = ClusterInput()
get_cell_segs = GetCellSegs_2(vertices=vertices)  # -> left_seg, right_seg, projection_seg
module_2 = Number(module)
diagonal = ClusterInput()
curved_arc = CurvedArc(segment=get_cell_segs.right_seg, module=module_2)  # -> curved_muqarnas_arc_2, module_3
curved_arc_2 = CurvedArc(segment=get_cell_segs.left_seg, module=module_2)  # -> curved_muqarnas_arc_2, module_3
diagonal_2 = Line(diagonal)
crv = Curve(curved_arc_2.curved_muqarnas_arc_2)
crv_2 = Curve(curved_arc.curved_muqarnas_arc_2)
multiplication = Multiplication(B="2")
Z = UnitZ(Factor=multiplication)
extr = Extrude(Base=diagonal_2, Direction=Z)
projecta = ProjectAlong(Geometry=crv, Plane=extr, Direction=get_cell_segs.projection_seg)  # -> Geometry, Transform
loft = Loft(
    Curves=flatten([projecta.Geometry, crv_2]),
    Options={Adjust=False, Closed=False, LoftEnds=0, LoftSimp=0, LoftType=3, Rebuild=10, Refit=0.01})
loft_2 = Loft(
    Curves=flatten([crv, projecta.Geometry]),
    Options={Adjust=False, Closed=False, LoftEnds=0, LoftSimp=0, LoftType=3, Rebuild=10, Refit=0.01})
join = BrepJoin(Breps=[loft_2, loft])  # -> LoftedInt, Closed
lofted_int = ClusterOutput(join.LoftedInt)

# ==== cluster _3RhombusesCurved
sym = ClusterInput()
dir = ClusterInput()
origin = ClusterInput()
sym_2 = Point(sym)
dir_2 = Point(dir)
origin_2 = Point(origin)
module = ClusterInput()
rhombus_45 = Rhombus45_2(origin=origin_2, direction_point=dir_2, symmetry_point=sym_2, module=module)  # -> rhombus_2, vertices_2, diagonal_bd, module_3
sym_3 = Point(sym_2)
dir_3 = Point(dir_2)
origin_3 = Point(origin_2)
make_curved_cell = MakeCurvedCell(vertices=rhombus_45.vertices_2, diagonal=rhombus_45.diagonal_bd, module=rhombus_45.module_3)

orient_angle = OrientAngle(angle=Slider(135, range=45..135), origin=origin_3, dir=dir_3, sym=sym_3)
build_partial_arrays = BuildPartialArrays(
    shape=rhombus_45.rhombus_2,
    vertices=rhombus_45.vertices_2,
    cell=make_curved_cell,
    count=Slider(3, range=0..10),
    angle=orient_angle)  # -> shape_partial_array, _3d_partial_array

join = BrepJoin(Breps=build_partial_arrays._3d_partial_array)  # -> Breps, Closed
shape_partial_array = ClusterOutput(build_partial_arrays.shape_partial_array)
array = ClusterOutput(join.Breps)

# ==== cluster GetNextPoints_2
shape_arrays = ClusterInput()
super_center = ClusterInput()
get_near_far = GetNearFar(shape_arrays=shape_arrays, center=super_center)  # -> union_2, near, far
alongcrv = SortAlongCurve(Points=get_near_far.far, Curve=get_near_far.union_2)  # -> Points, Indices
alongcrv_2 = SortAlongCurve(Points=get_near_far.near, Curve=get_near_far.union_2)  # -> Points, Indices
points = PointList(Points=alongcrv_2.Points, Size=Slider(0.381, range=0..1))
item = ListItem(List=alongcrv_2.Points, Index=0, Wrap=True)  # -> Item, Item1
origin = Point(item.Item1)
get_dir_sym = GetDirSym(near_pt=item.Item1, far_list=alongcrv.Points)  # -> direction_pt_2, symmetry_pt_2
union = ClusterOutput(get_near_far.union_2)
origin_2 = ClusterOutput(origin)
direction_pt = ClusterOutput(get_dir_sym.direction_pt_2)
symmetry_pt = ClusterOutput(get_dir_sym.symmetry_pt_2)

# ==== cluster Cell12Curved
vertices = ClusterInput()
item = ListItem(Vertices=vertices, Index=0, Wrap=True)  # -> Item, Item1, Item2
module = ClusterInput()
module_2 = Number(module)
ln = Line(StartPoint=item.Item2, EndPoint=item.Item)
ln_2 = Line(StartPoint=item.Item1, EndPoint=item.Item)
curved_arc = CurvedArc(segment=ln_2, module=module_2)  # -> curved_muqarnas_arc_2, module_3
curved_arc_2 = CurvedArc(segment=ln, module=module_2)  # -> curved_muqarnas_arc_2, module_3
loft = Loft(
    Curves=[curved_arc.curved_muqarnas_arc_2, curved_arc_2.curved_muqarnas_arc_2],
    Options={Adjust=False, Closed=False, LoftEnds=0, LoftSimp=0, LoftType=0, Rebuild=10, Refit=0.01})
cell = ClusterOutput(loft)

# ==== cluster Fix3DArray
super_center = ClusterInput()
shape_count = ClusterInput()
array = ClusterInput()
super_center_2 = Point(super_center)
shape_count_2 = Number(shape_count)
array_2 = Geometry(array)
item = ListItem(List=array_2, Index=0, Wrap=True)  # -> Item1, Item, Item1_2
split = SplitBrep(Brep=item.Item, Cutter=item.Item1_2)  # -> flatten(Result)
item_2 = ListItem(List=split, Index=0, Wrap=True)  # -> Item, Item1
split_2 = SplitBrep(Brep=item_2.Item1, Cutter=item.Item1)
item_3 = ListItem(List=split_2, Index=0, Wrap=True)  # -> Item, Item1
geo = Geometry(item_3.Item1)
arrpolar = PolarArray(Geometry=geo, Plane=super_center_2, ShapeCount=shape_count_2, Angle=6.283185307)  # -> Geometry, Transform
fixed_array = Geometry(arrpolar.Geometry)
fixed_array_2 = ClusterOutput(fixed_array)

# ==== cluster SimpleArc
segment = ClusterInput()
segment_2 = Line(segment)
module = ClusterInput()
explode = Explode(Curve=segment_2, Recursive=True)  # -> Segments, Vertices
Z = UnitZ(Factor=1)
item = ListItem(List=explode.Vertices, Index=0, Wrap=True)  # -> Item, Item1
directionpt = Point(item.Item)
module_2 = Number(module)
D = Point(item.Item1)
move = Move(Geometry=D, Motion=Z)  # -> Geometry, Transform
module_3 = ClusterOutput(module_2)
heightpt = Point(move.Geometry)
multiplication = Multiplication(A=module_2, B=Slider(2, range=1..3))
odir = Vector2Pt(PointA=D, PointB=directionpt, Unitize=False)  # -> Vector, Length
ohei = Vector2Pt(PointA=D, PointB=heightpt, Unitize=False)  # -> Vector, Length
line = LineSDL(Start=D, Direction=odir.Vector, Length=module_2)
line_2 = LineSDL(Start=D, Direction=ohei.Vector, Length=multiplication)
curvepoint = PointOnCurve(line_2, parameter=1)
curvepoint_2 = PointOnCurve(line, parameter=1)
D_2 = Point(D)
A = Point(curvepoint)
G = Point(curvepoint_2)
module_4 = Number(module_2)
dgba = Rectangle3Pt(PointA=D_2, PointB=G, PointC=A)  # -> Rectangle, Length
explode_2 = Explode(Curve=dgba.Rectangle, Recursive=True)  # -> Segments, Vertices
segments = ListItem(List=explode_2.Segments, Index=0, Wrap=True)  # -> Item, Item1, Item2, Item3
vertices = ListItem(List=explode_2.Vertices, Index=0, Wrap=True)  # -> Item, Item1, Item2, Item3
A_2 = Point(vertices.Item3)
D_3 = Point(vertices.Item)
G_2 = Point(vertices.Item1)
B = Point(vertices.Item2)
ab = Line(segments.Item2)
ad = Line(segments.Item3)
gb = Line(segments.Item1)
dg = Line(segments.Item)
ab_2 = Vector2Pt(PointA=A_2, PointB=B, Unitize=False)  # -> Vector, Length
ad_2 = Vector2Pt(PointA=A_2, PointB=D_3, Unitize=False)  # -> Vector, Length
xprod = CrossProduct(VectorA=ab_2.Vector, VectorB=ad_2.Vector, Unitize=False)  # -> Vector, Length
ae_base = Rotate3D(Geometry=ab, Angle=degrees(Slider(30, range=30..31)), Center=A_2, Axis=xprod.Vector)  # -> Geometry, Transform
ae_long = ExtendCurve(Curve=ae_base.Geometry, Type=0, Start=module_4, End=module_4)
E = CurveCurve(CurveA=gb, CurveB=ae_long)  # -> Points, ParamsA, ParamsB
ge = Line(StartPoint=G_2, EndPoint=E.Points)
ea = Line(StartPoint=E.Points, EndPoint=A_2)
join = JoinCurves(Curves=[ge, ea], Preserve=False)
simple_muqarnas_arc = ClusterOutput(join)

# ==== cluster GetCellSegs
vertices = ClusterInput()
item = ListItem(Vertices=vertices, Index=0, Wrap=True)  # -> Item, Item1, Item2, Item3
ln = Line(StartPoint=item.Item1, EndPoint=item.Item)
ln_2 = Line(StartPoint=item.Item3, EndPoint=item.Item)
ln_3 = Line(StartPoint=item.Item3, EndPoint=item.Item2)
projection_seg = ClusterOutput(ln_3)
left_seg = ClusterOutput(ln_2)
right_seg = ClusterOutput(ln)

# ==== cluster BuildSquareForBiped
directionpt = ClusterInput()
symmetrypt = ClusterInput()
origin = ClusterInput()
module = ClusterInput()
origin_2 = Point(origin)
module_2 = Number(module)
vec2pt = Vector2Pt(PointA=origin_2, SymmetryPt=symmetrypt, Unitize=False)  # -> Vector, Length
vec2pt_2 = Vector2Pt(PointA=origin_2, DirectionPt=directionpt, Unitize=False)  # -> Vector, Length
xprod = CrossProduct(VectorA=vec2pt_2.Vector, VectorB=vec2pt.Vector, Unitize=False)  # -> Vector, Length
line = LineSDL(Start=origin_2, Direction=vec2pt_2.Vector, Length=module_2)
rot3d = Rotate3D(Geometry=line, Angle=degrees(Slider(90, range=45..90)), Center=origin_2, Axis=xprod.Vector)  # -> Geometry, Transform
curvepoint = PointOnCurve(line, parameter=1)
curvepoint_2 = PointOnCurve(rot3d.Geometry, parameter=1)
rec_3pt = Rectangle3Pt(PointA=origin_2, PointB=curvepoint, PointC=curvepoint_2)  # -> Rectangle, Length
explode = Explode(Curve=rec_3pt.Rectangle, Recursive=True)  # -> Segments, Vertices
item = ListItem(List=explode.Vertices, Index=0, Wrap=True)  # -> Item, Item1, Item2, Item3
ln = Line(StartPoint=item.Item2, EndPoint=item.Item)
pt = Point(item.Item2)
rec_3pt_2 = Rectangle3Pt(PointA=pt, PointB=curvepoint, PointC=curvepoint_2)  # -> ReverseSquare, Length
square = ClusterOutput(rec_3pt.Rectangle)
module_3 = ClusterOutput(module_2)
diagonal_da = ClusterOutput(ln)
reverse_square = ClusterOutput(rec_3pt_2.ReverseSquare)
vertices = ClusterOutput(explode.Vertices)

# ==== cluster GetCellSegs_2
vertices = ClusterInput()
item = ListItem(Vertices=vertices, Index=0, Wrap=True)  # -> Item, Item1, Item2, Item3
ln = Line(StartPoint=item.Item2, EndPoint=item.Item3)
ln_2 = Line(StartPoint=item.Item2, EndPoint=item.Item1)
ln_3 = Line(StartPoint=item.Item1, EndPoint=item.Item)
projection_seg = ClusterOutput(ln_3)
left_seg = ClusterOutput(ln_2)
right_seg = ClusterOutput(ln)

# ==== cluster GetNearFar
shape_arrays = ClusterInput()
center = ClusterInput()
runion = RegionUnion(ShapeArrays=simplify(flatten(shape_arrays)))
center_2 = Point(center)
union = Curve(runion)

# ----
# get vertices, without duplicates
explode = Explode(Curve=runion, Recursive=True)  # -> Segments, Vertices
cset = CreateSet(List=explode.Vertices)  # -> Set, Map

# ----
# get the points and sort them by distance to the center
lng = ListLength(List=cset.Set)
cps = ClosestPoints(Point=center_2, Cloud=cset.Set, Count=lng)  # -> ClosestPoint, CPIndex, Distance
sort = SortList(Keys=cps.Distance, ValuesA=cps.ClosestPoint)  # -> Keys, ValuesA

# ----
# split into 2 equal-sized lists: the near points and the far points
panel = Panel("2")
division = Division(A=lng, B=panel)
split = SplitList(List=sort.ValuesA, Index=division)  # -> ListA, ListB

points = PointList(Points=split.ListA, Size=Slider(0.3, range=0..1))
cset_2 = CreateSet(List=cps.Distance)  # -> Set, Map
lng_2 = ListLength(List=cset_2.Set)
python = GhPythonScript(x=lng_2)  # -> out, a
# ---------- python: Python ----------
__author__ = "marga"
__version__ = "2022.12.21"

import rhinoscriptsyntax as rs

a = (x==2)
# ---------- end python ----------
union_2 = ClusterOutput(union)
near = ClusterOutput(split.ListA)
far = ClusterOutput(split.ListB)
gate = StreamGate(Stream=sort.ValuesA, Gate=python.a)  # -> Target0, Target1

# ==== cluster GetDirSym
far_list = ClusterInput()
near_pt = ClusterInput()

# ----
# for a given point in Near, get the 2 closest points in Far
panel = Panel("2")
cps = ClosestPoints(NearPt=near_pt, FarList=far_list, Count=panel)  # -> ClosestPoint, CPIndex, Distance
item = ListItem(List=cps.ClosestPoint, Index=0, Wrap=True)  # -> Item, Item1
direction_pt = Point(item.Item)
symmetry_pt = Point(item.Item1)

direction_pt_2 = ClusterOutput(direction_pt)
symmetry_pt_2 = ClusterOutput(symmetry_pt)

# ==== cluster Rhombus45_2
symmetry_point = ClusterInput()
direction_point = ClusterInput()
module = ClusterInput()
origin = ClusterInput()
module_2 = Number(module)
symmetry_point_2 = Point(symmetry_point)
direction_point_2 = Point(direction_point)
origin_2 = Point(origin)
module_3 = ClusterOutput(module_2)
vec2pt = Vector2Pt(PointA=origin_2, PointB=direction_point_2, Unitize=False)  # -> Vector, Length
pl_3pt = Plane3Pt(PointA=origin_2, PointB=direction_point_2, PointC=symmetry_point_2)
vec2pt_2 = Vector2Pt(PointA=origin_2, PointB=symmetry_point_2, Unitize=False)  # -> Vector, Length
panel = Panel("Rhombus")
ba = LineSDL(Start=origin_2, Direction=vec2pt.Vector, Length=module_2)
ba_2 = Line(ba)
B = Point(simplify(flatten(origin_2)))
ba_3 = Line(ba)
bg = Rotate(Geometry=ba_2, Angle=degrees(Slider(45, range=0..100)), Plane=pl_3pt)  # -> Geometry, Transform
curvepoint = PointOnCurve(ba_3, parameter=1)
curvepoint_2 = PointOnCurve(bg.Geometry, parameter=1)
A = Point(simplify(flatten(curvepoint)))
G = Point(simplify(flatten(curvepoint_2)))
vec = Vector(bg.Geometry)
ag = Line(StartPoint=G, EndPoint=A)
gd = Move(Geometry=ba_3, Motion=vec)  # -> Geometry, Transform
line = LineSDL(Start=G, Direction=expr("-x", vec2pt_2.Vector), Length=module_2)
curvepoint_3 = PointOnCurve(gd.Geometry, parameter=1)
curvepoint_4 = PointOnCurve(ag, parameter=0.5)
ccx = CurveCurve(CurveA=ba_2, CurveB=line)  # -> Points, ParamsA, ParamsB
D = Point(simplify(flatten(curvepoint_3)))
vertices = Point([B, A, D, G])
bd = Line(StartPoint=B, EndPoint=D)
item = ListItem(List=vertices, Index=Slider(0, range=0..3), Wrap=True)
vertices_2 = ClusterOutput(vertices)
bd_2 = Line(StartPoint=B, EndPoint=D)
ad = Line(StartPoint=A, EndPoint=D)
E = Point(curvepoint_4)
join = JoinCurves(Curves=flatten([bg.Geometry, ba_3, gd.Geometry, ad]), Preserve=False)  # -> simplify(flatten(Curves))
rhombus = Curve(join)
diagonal_bd = ClusterOutput(bd)
rhombus_2 = ClusterOutput(rhombus)

# ==== cluster BuildPartialArrays
vertices = ClusterInput()
shape = ClusterInput()
vertices_2 = Point(vertices)
cell = ClusterInput()
shape_2 = Curve(shape)
count = ClusterInput()
angle = ClusterInput()
item = ListItem(List=vertices_2, Index=0, Wrap=True)
cell_2 = Brep(cell)
angle_2 = Number(angle)
count_2 = Number(count)
arrpolar = PolarArray(Geometry=shape_2, Plane=item, Count=count_2, Angle=degrees(angle_2))  # -> ShapePartialArray, Transform
arrpolar_2 = PolarArray(Geometry=cell_2, Plane=item, Count=count_2, Angle=degrees(angle_2))  # -> _3DPartialArray, Transform
shape_partial_array = ClusterOutput(arrpolar.ShapePartialArray)
_3d_partial_array = ClusterOutput(arrpolar_2._3DPartialArray)

# ==== cluster OrientAngle
origin = ClusterInput()
dir = ClusterInput()
sym = ClusterInput()
angle = ClusterInput()
origin_2 = Point(origin)
dir_2 = Point(dir)
sym_2 = Point(sym)
angle_2 = Number(angle)
vec2pt = Vector2Pt(PointA=origin_2, PointB=dir_2, Unitize=False)  # -> Vector, Length
vec2pt_2 = Vector2Pt(PointA=origin_2, PointB=sym_2, Unitize=False)  # -> Vector, Length
xprod = CrossProduct(VectorA=vec2pt.Vector, VectorB=vec2pt_2.Vector, Unitize=True)  # -> Vector, Length
devec = DeconstructVector(Vector=xprod.Vector)  # -> XComponent, YComponent, ZComponent
multiplication = Multiplication(A=angle_2, B=devec.ZComponent)
num = Number(multiplication)
num_2 = ClusterOutput(num)

# ==== cluster GetHeight
module = ClusterInput()
module_2 = Number(module)
multiplication = Multiplication(A=module_2, B=2)
tier_height = Number(multiplication)
tier_height_2 = ClusterOutput(tier_height)

# ==== cluster CurvedArc
segment = ClusterInput()
segment_2 = Line(segment)
module = ClusterInput()
explode = Explode(Curve=segment_2, Recursive=True)  # -> Segments, Vertices
Z = UnitZ(Factor=1)
item = ListItem(List=explode.Vertices, Index=0, Wrap=True)  # -> Item, Item1
directionpt = Point(item.Item)
module_2 = Number(module)
D = Point(item.Item1)
move = Move(Geometry=D, Motion=Z)  # -> Geometry, Transform
module_3 = ClusterOutput(module_2)
heightpt = Point(move.Geometry)
multiplication = Multiplication(A=module_2, B=Slider(2, range=1..3))
odir = Vector2Pt(PointA=D, PointB=directionpt, Unitize=False)  # -> Vector, Length
ohei = Vector2Pt(PointA=D, PointB=heightpt, Unitize=False)  # -> Vector, Length
line = LineSDL(Start=D, Direction=odir.Vector, Length=module_2)
line_2 = LineSDL(Start=D, Direction=ohei.Vector, Length=multiplication)
curvepoint = PointOnCurve(line_2, parameter=1)
curvepoint_2 = PointOnCurve(line, parameter=1)
D_2 = Point(D)
A = Point(curvepoint)
G = Point(curvepoint_2)
module_4 = Number(module_2)
dgba = Rectangle3Pt(PointA=D_2, PointB=G, PointC=A)  # -> Rectangle, Length
explode_2 = Explode(Curve=dgba.Rectangle, Recursive=True)  # -> Segments, Vertices
segments = ListItem(List=explode_2.Segments, Index=0, Wrap=True)  # -> Item, Item1, Item2, Item3
vertices = ListItem(List=explode_2.Vertices, Index=0, Wrap=True)  # -> Item, Item1, Item2, Item3
A_2 = Point(vertices.Item3)
D_3 = Point(vertices.Item)
G_2 = Point(vertices.Item1)
B = Point(vertices.Item2)
ab = Line(segments.Item2)
ad = Line(segments.Item3)
gb = Line(segments.Item1)
dg = Line(segments.Item)
G_3 = Point(G_2)
ab_2 = Vector2Pt(PointA=A_2, PointB=B, Unitize=False)  # -> Vector, Length
ad_2 = Vector2Pt(PointA=A_2, PointB=D_3, Unitize=False)  # -> Vector, Length
xprod = CrossProduct(VectorA=ab_2.Vector, VectorB=ad_2.Vector, Unitize=False)  # -> Vector, Length
ae_base = Rotate3D(Geometry=ab, Angle=degrees(Slider(30, range=30..31)), Center=A_2, Axis=xprod.Vector)  # -> Geometry, Transform
A_3 = Point(A_2)
ae_long = ExtendCurve(Curve=ae_base.Geometry, Type=0, Start=module_4, End=module_4)
E = CurveCurve(CurveA=gb, CurveB=ae_long)  # -> Points, ParamsA, ParamsB
ge = Line(StartPoint=G_2, EndPoint=E.Points)
ea = Line(StartPoint=E.Points, EndPoint=A_2)
divide = DivideCurve(Curve=ea, Count=Slider(5, range=5..6), Kinks=False)  # -> Points, Tangents, Parameters
item_2 = ListItem(List=divide.Points, Index=Slider(2, range=2..3), Wrap=True)

# ----
# Get segment EH equal to EZ
E_2 = Point(E.Points)
Z_2 = Point(item_2)
ln = Line(StartPoint=E_2, EndPoint=Z_2)
len = Length(Curve=ln)
rev = Reverse(Vector=ge)
line_3 = LineSDL(Start=E_2, Direction=rev, Length=len)

end = EndPoints(Curve=line_3)  # -> Start, End
A_4 = Point(A_3)
G_4 = Point(G_3)
rect = Surface(dgba.Rectangle)

# ----
# Create 2 circles of radius ZH
Z_3 = Point(item_2)
H = Point(end.End)
H_2 = Point(H)
Z_4 = Point(Z_3)
ln_2 = Line(StartPoint=Z_3, EndPoint=H)
len_2 = Length(Curve=ln_2)

Z_5 = Point(Z_3)
ln_3 = Line(StartPoint=Z_5, EndPoint=A_4)
H_3 = Point(H)

rect_2 = Surface(dgba.Rectangle)
pl_origin = PlaneOrigin(Base=rect_2, Origin=H_2)

rect_3 = Surface(dgba.Rectangle)
pl_origin_2 = PlaneOrigin(Base=rect_3, Origin=Z_4)

ln_4 = Line(StartPoint=G_4, EndPoint=H_3)
radius_zh = Number(len_2)

cir = Circle(Plane=pl_origin_2, Radius=radius_zh)
cir_2 = Circle(Plane=pl_origin, Radius=radius_zh)

# ----
# Get T, intersection of the 2 circles within the rectangle
ccx = CurveCurve(CurveA=cir, CurveB=cir_2)  # -> Points, ParamsA, ParamsB
item_3 = ListItem(List=ccx.Points, Index=0, Wrap=True)  # -> Item, Item1

T = Point(item_3.Item1)

pl_origin_3 = PlaneOrigin(Base=rect, Origin=T)
radius_zh_2 = Number(len_2)
cir_3 = Circle(Plane=pl_origin_3, Radius=radius_zh_2)

curvepoint_3 = PointOnCurve(cir_3, parameter=0.349)
H_4 = Point(H)
Z_6 = Point(Z_3)
hz_arc = Arc3Pt(PointA=Z_6, PointB=curvepoint_3, PointC=H_4)  # -> Arc, Plane, Radius

za = Curve(ln_3)

# ----
# Join necessary curves to get arc
hz = Curve(hz_arc.Arc)
gh = Curve(ln_4)
za_2 = Curve(za)
join = JoinCurves(Curves=flatten([gh, hz, za_2]), Preserve=False)

curved_muqarnas_arc = Curve(join)
curved_muqarnas_arc_2 = ClusterOutput(curved_muqarnas_arc)
